# Grasshopper definition JESS.gh (Grasshopper 1.0.7)
# plug-ins: GH_CPython, jSwan, FalseStartToggle

# GH_CPython with python 3.8 is used
# to use requests module
# Use sticky to remove the need for cookie wires
panel = Panel("C:/Users/amd/Documents/GitHub/JESS-Grasshopper/cookie.txt")
false_start_toggle = FalseStartToggle(False)
# Native python in Grasshopper uses urllib, urllib2.
# Ironpython is not compatible with "requests" module
ghpython_script = GhPythonScript()  # -> out, a; unedited script template
ghpython_script_2 = GhPythonScript()  # -> out, a; unedited script template
eto_form = GhPythonScript(run=false_start_toggle)  # -> login, password
# ---------- eto_form: Python ----------
#This script is based on source code https://developer.rhino3d.com/guides/rhinopython/eto-forms-python/#the-layout

import Rhino
import scriptcontext
import System
import Rhino.UI
import Eto.Drawing as drawing
import Eto.Forms as forms

# Eto dialog class
class EtoDialogClass(forms.Dialog[bool]):

    # Dialog box Class initializer
    def __init__(self):
        # Initialize dialog box
        self.Title = 'ENSIMS/JESS login'
        self.Padding = drawing.Padding(10)
        self.Resizable = False

        # Create controls for the dialog
        self.m_label = forms.Label(Text = 'Enter the login:')
        self.m_textbox = forms.TextBox(Text = None)
        self.p_label = forms.Label(Text = 'Enter the password:')
        self.p_textbox = forms.PasswordBox()

        # Create the default button
        self.DefaultButton = forms.Button(Text = 'OK')
        self.DefaultButton.Click += self.OnOKButtonClick

        # Create the abort button
        self.AbortButton = forms.Button(Text = 'Cancel')
        self.AbortButton.Click += self.OnCloseButtonClick

        # Create a table layout and add all the controls
        layout = forms.DynamicLayout()
        layout.Spacing = drawing.Size(5, 5)
        layout.AddRow(self.m_label, self.m_textbox)
        layout.AddRow(self.p_label, self.p_textbox)
        layout.AddRow(None) # spacer
        layout.AddRow(self.DefaultButton, self.AbortButton)

        # Set the dialog content
        self.Content = layout

    # Start of the class functions
    global data
    # Get the value of the textbox
    def GetText(self):
        data = {"login":self.m_textbox.Text, "password":self.p_textbox.Text}
        return data

    def GetLogin(self):
        return self.m_textbox.Text

    def GetPassword(self):
        return self.p_textbox.Text

    # Close button click handler
    def OnCloseButtonClick(self, sender, e):
        self.m_textbox.Text = ""
        self.Close(False)

    # OK button click handler
    def OnOKButtonClick(self, sender, e):
        if self.m_textbox.Text == "":
            self.Close(False)
        else:
            self.Close(True)

    ## End of Dialog Class ##

# The script that will be using the dialog.
def LoginDialog():
    dialog = EtoDialogClass();
    rc = dialog.ShowModal(Rhino.UI.RhinoEtoApp.MainWindow)
    global login, password
    login = dialog.GetLogin()
    password = dialog.GetPassword()
    if (rc):
        print dialog.GetText() #Print the Room Number from the dialog control

##########################################################################
# Check to see if this file is being executed as the "main" python
# script instead of being used as a module by some other python script
# This allows us to use the module which ever way we want.
if __name__ == "__main__":
    if run == True:
        LoginDialog()
# ---------- end eto_form ----------
ensims_login = EnsimsLogin(login=eto_form.login, password=eto_form.password, cookie=panel)  # -> output, cookie; inputs login: list, password: list, cookie: list
# ---------- ensims_login: Python ----------
# -*- coding: utf-8 -*-
""" 
Python Script
Created on  Sunday September 2020 09:06:17 
@author:  amd 

[desc]
Description of the plugin Here
Write here any thing... 
[/desc]

ARGUMENTS:
----------
<inp> 
    login :[required] - [type = string] - [default = None] 
    Descripe your input here 
        * bullet point
</inp>
<inp> 
    password :[required] - [type = string] - [default = None] 
    Descripe your input here 
        * bullet point
</inp>
<inp> 
    cookie :[required] - [type = string] - [default = None] 
    Descripe your input here 
        * bullet point
</inp>
RETURN:
----------
    <out>
        output : indicate your output description here. \n refers to a new line.
    </out>
    <out>
        cookie : indicate your output description here. \n refers to a new line.
    </out>
"""

import requests, pickle
ApiBase = 'https://api.ensims.com/'
UserApi = ApiBase + 'users/api/'
r = requests.get(UserApi + 'info')

# Set header and body of the POST request
headers = {'Content-Type': 'application/json'}
body = {"email": login, "password": password}
r = requests.post(UserApi + 'auth', headers=headers, json=body)
cookies = r.cookies

#dump cookies into file
with open(cookie, 'wb') as f:
    pickle.dump(r.cookies, f)
output = []
output.append(r.json())
r = requests.post(UserApi + 'checkin', cookies=cookies)
if r.json()['ok']:
    cookies = r.cookies
    output.append(r.json())
else:
    cookie = None
# ---------- end ensims_login ----------
# {
#     "command": "Create",
#     "projectID": "circle-py",
#     "problem": {
#         "name": "circle",
#         "description": "Test constrained mo fucntion with two variables",
#         "variables": [
#             {
#                 "name": "x",
#                 "caption": "x in [0, 1]",
#                 "valueStr": "[0:0.01:1]",
#                 "maskStr": "[0:0.1:1]",
#                 "valueType": "Number"
#             },
#             {
#                 "name": "y",
#                 "caption": "y in [0, 1]",
#                 "valueStr": "[0:0.01:1]",
#                 "maskStr": "[0:0.1:1]",
#                 "valueType": "Number"
#             }
#         ],
#         "evalResults": [
#             {
#                 "name": "f1",
#                 "caption": "Evaluation f1 = 100 * x",
#                 "unit": "-"
#             },
#             {
#                 "name": "f2",
#                 "caption": "Evaluation f2 = 100 * y",
#                 "unit": "-"
#             }
#         ],
#         "userMetrics": [],
#         "objectives": [
#             {
#                 "name": "t1",
#                 "caption": "Objective t1 = f1",
#                 "unit": "-",
#                 "direction": "Minimize",
#                 "formula": "f1"
#             },
#             {
#                 "name": "t2",
#                 "caption": "Objective t2 = f2",
#                 "unit": "-",
#                 "direction": "Minimize",
#                 "formula": "f2"
#             }
#         ],
#         "constraints": [
#             {
#                 "name": "s1",
#                 "caption": "Constraint s1 <= 30",
#                 "unit": "-",
#                 "formula": "Math.sqrt(Math.pow(f1-50, 2) + Math.pow(f2-50, 2))",
#                 "lb": 0,
#                 "ub": 30,
#                 "min": 0,
#                 "max": 100,
#                 "weight": 1
#             }
#         ]
#     },
#     "config": {
#         "algorithm": "Parametrics",
#         "sampleSize": 0,
#         "initSampleOption": "RANDOM",
#         "initPopSize": 10,
#         "evolvePopSize": 10,
#         "maxPopSize": 10000,
#         "mutationRate": 0.2,
#         "crossoverRate": 1,
#         "tournamentSize": 2,
#         "objectiveBias": 0,
#         "elitismTolerance": 0,
#         "maxGenerations": 100,
#         "maxEvaluations": 1000,
#         "maxComputingTime": 100,
#         "maxWallTime": 24
#     },
#     "smdata": {
#         "modelID": "circle",
#         "model": "",
#         "type": "Python3"
#     }
# }
false_start_toggle_2 = FalseStartToggle(False)
ghpython_script_3 = GhPythonScript(cookie=ensims_login.cookie)
# ---------- ghpython_script_3: Python ----------
__author__ = "BT"
__version__ = "2020.09.29"

import scriptcontext as rs

rs.sticky["cookie"] = cookie
# ---------- end ghpython_script_3 ----------
panel_2 = Panel(ensims_login.output)
ghpython_script_4 = GhPythonScript()  # -> cookie
# ---------- ghpython_script_4: Python ----------
__author__ = "BT"
__version__ = "2020.09.29"

import scriptcontext as rs

cookie = rs.sticky["cookie"] #output the value of the sticky
# ---------- end ghpython_script_4 ----------
eto_form_2 = GhPythonScript(run=false_start_toggle_2)  # -> login, password
# ---------- eto_form_2: Python ----------
#source code https://developer.rhino3d.com/guides/rhinopython/eto-forms-python/#the-layout

# Imports
import Rhino
import scriptcontext
import System
import Rhino.UI
import Eto.Drawing as drawing
import Eto.Forms as forms

# SampleEtoRoomNumber dialog class
class SampleEtoRoomNumberDialog(forms.Dialog[bool]):

    # Dialog box Class initializer
    def __init__(self):
        # Initialize dialog box
        self.Title = 'ENSIMS/JESS login'
        self.Padding = drawing.Padding(10)
        self.Resizable = False

        # Create controls for the dialog
        self.m_label = forms.Label(Text = 'Enter the login:')
        self.m_textbox = forms.TextBox(Text = None)
        self.p_label = forms.Label(Text = 'Enter the password:')
        self.p_textbox = forms.TextBox(Text = None)

        # Create the default button
        self.DefaultButton = forms.Button(Text = 'OK')
        self.DefaultButton.Click += self.OnOKButtonClick

        # Create the abort button
        self.AbortButton = forms.Button(Text = 'Cancel')
        self.AbortButton.Click += self.OnCloseButtonClick

        # Create a table layout and add all the controls
        layout = forms.DynamicLayout()
        layout.Spacing = drawing.Size(5, 5)
        layout.AddRow(self.m_label, self.m_textbox)
        layout.AddRow(self.p_label, self.p_textbox)
        layout.AddRow(None) # spacer
        layout.AddRow(self.DefaultButton, self.AbortButton)

        # Set the dialog content
        self.Content = layout

    # Start of the class functions
    global data
    # Get the value of the textbox
    def GetText(self):
        data = {"login":self.m_textbox.Text, "password":self.p_textbox.Text}
        return data

    def GetLogin(self):
        return self.m_textbox.Text

    def GetPassword(self):
        return self.p_textbox.Text

    # Close button click handler
    def OnCloseButtonClick(self, sender, e):
        self.m_textbox.Text = ""
        self.Close(False)

    # OK button click handler
    def OnOKButtonClick(self, sender, e):
        if self.m_textbox.Text == "":
            self.Close(False)
        else:
            self.Close(True)

    ## End of Dialog Class ##

# The script that will be using the dialog.
def RequestRoomNumber():
    dialog = SampleEtoRoomNumberDialog();
    rc = dialog.ShowModal(Rhino.UI.RhinoEtoApp.MainWindow)
    global login, password
    login = dialog.GetLogin()
    password = dialog.GetPassword()
    if (rc):
        print dialog.GetText() #Print the Room Number from the dialog control

##########################################################################
# Check to see if this file is being executed as the "main" python
# script instead of being used as a module by some other python script
# This allows us to use the module which ever way we want.
if __name__ == "__main__":
    if run == True:
        RequestRoomNumber()
# ---------- end eto_form_2 ----------
create_jea_project = CreateJEAProject(cookie=ghpython_script_4)  # -> output, project_id; inputs cookie: list
# ---------- create_jea_project: Python ----------
# -*- coding: utf-8 -*-
""" 
Python Script
Created on  Tuesday September 2020 08:46:17 
@author:  BT 

[desc]
Description of the plugin Here
Write here any thing... 
[/desc]

ARGUMENTS:
----------
<inp> 
    cookie :[required] - [type = string] - [default = None] 
    Descripe your input here 
        * bullet point.
        * bullet point
</inp>
<inp> 
    json :[required] - [type = string] - [default = None] 
    Descripe your input here 
        * bullet point.
        * bullet point
</inp>

RETURN:
----------
    <out>
        output : indicate your output description here. \n refers to a new line.
    </out>

"""
import requests, pickle

# API endpoint URL
ApiBase = 'https://api.ensims.com/'
JeaApi = ApiBase + "jea_web/api/"

#Load cookie
r = requests.get(JeaApi + 'info')
with open(cookie, 'rb') as f:
    r.cookies.update(pickle.load(f))

json = {
    "command": "Create",
    "projectID": "circle-py",
    "problem": {
        "name": "circle",
        "description": "Test constrained mo fucntion with two variables",
        "variables": [
            {
                "name": "x",
                "caption": "x in [0, 1]",
                "valueStr": "[0:0.01:1]",
                "maskStr": "[0:0.1:1]",
                "valueType": "Number"
            },
            {
                "name": "y",
                "caption": "y in [0, 1]",
                "valueStr": "[0:0.01:1]",
                "maskStr": "[0:0.1:1]",
                "valueType": "Number"
            }
        ],
        "evalResults": [
            {
                "name": "f1",
                "caption": "Evaluation f1 = 100 * x",
                "unit": "-"
            },
            {
                "name": "f2",
                "caption": "Evaluation f2 = 100 * y",
                "unit": "-"
            }
        ],
        "userMetrics": [],
        "objectives": [
            {
                "name": "t1",
                "caption": "Objective t1 = f1",
                "unit": "-",
                "direction": "Minimize",
                "formula": "f1"
            },
            {
                "name": "t2",
                "caption": "Objective t2 = f2",
                "unit": "-",
                "direction": "Minimize",
                "formula": "f2"
            }
        ],
        "constraints": [
            {
                "name": "s1",
                "caption": "Constraint s1 <= 30",
                "unit": "-",
                "formula": "Math.sqrt(Math.pow(f1-50, 2) + Math.pow(f2-50, 2))",
                "lb": 0,
                "ub": 30,
                "min": 0,
                "max": 100,
                "weight": 1
            }
        ]
    },
    "config": {
        "algorithm": "Parametrics",
        "sampleSize": 0,
        "initSampleOption": "RANDOM",
        "initPopSize": 10,
        "evolvePopSize": 10,
        "maxPopSize": 10000,
        "mutationRate": 0.2,
        "crossoverRate": 1,
        "tournamentSize": 2,
        "objectiveBias": 0,
        "elitismTolerance": 0,
        "maxGenerations": 100,
        "maxEvaluations": 1000,
        "maxComputingTime": 100,
        "maxWallTime": 24
    },
    "smdata": {
        "modelID": "circle",
        "model": "",
        "type": "Python3"
    }
}

project_id = json['projectID']

# Send command
r = requests.post(JeaApi + 'command', json=json, cookies=r.cookies)

# Show response
output = r.json()
# ---------- end create_jea_project ----------
panel_3 = Panel("""('file', ('5ZoneAirCooled-v93.idf', open("C:/Users/amd/Documents/GitHub/JESS-Grasshopper/job_example/5ZoneAirCooled-v93.idf", 'rb'), 'text/plain'))
('file', ('in.epw', open("C:/Users/amd/Documents/GitHub/JESS-Grasshopper/job_example/in.epw", 'rb'), 'text/plain'))
('title', 'Test job')
('desc', 'This is test submission made from python example')
('model', '5ZoneAirCooled-v93.idf')
('split', 'FALSE')
('weather', 'in.epw')""")
panel_4 = Panel("""('file', ('5ZoneAirCooled-v93.idf', open("C:/Users/amd/Documents/GitHub/JESS-Grasshopper/job_example/5ZoneAirCooled-v93.idf", 'rb'), 'text/plain'))
('file', ('in.epw', open("C:/Users/amd/Documents/GitHub/JESS-Grasshopper/job_example/in.epw", 'rb'), 'text/plain'))
('title', 'Test job')
('desc', 'This is test submission made from python example')
('model', '5ZoneAirCooled-v93.idf')
('split', 'FALSE')
('weather', 'in.epw')""")
jess_login = JESSLogin(login=eto_form_2.login, password=eto_form_2.password, cookie=ensims_login.cookie)  # -> output; inputs login: list, password: list, cookie: list
# ---------- jess_login: Python ----------
# -*- coding: utf-8 -*-
""" 
Python Script
Created on  Sunday September 2020 09:06:17 
@author:  amd 

[desc]
Description of the plugin Here
Write here any thing... 
[/desc]

ARGUMENTS:
----------
<inp> 
    login :[required] - [type = string] - [default = None] 
    Descripe your input here 
        * bullet point.
        * bullet point
</inp>
<inp> 
    password :[required] - [type = string] - [default = None] 
    Descripe your input here 
        * bullet point.
        * bullet point
</inp>
<inp>
    Other inputs go here ...
</inp>

RETURN:
----------
    <out>
        output_ : indicate your output description here. \n refers to a new line.
    </out>

"""
# Use requests (see https://requests.readthedocs.io/en/master/)
import requests, pickle

# API endpoint URL
ApiBase = 'https://api.ensims.com/'
JessApi = ApiBase + 'jess_web/api/'

#Load ENSIMS cookie
r = requests.get(JessApi + 'info')
with open(cookie, 'rb') as f:
    r.cookies.update(pickle.load(f))

# Set header and body of the POST request
headers = {'Content-Type': 'application/json'}
body = {"jessUser": login, "jessPwd": password}
r = requests.post(JessApi + 'session', headers=headers, json=body, cookies=r.cookies)
output = r.json()
# ---------- end jess_login ----------
panel_5 = Panel(create_jea_project.output)
get_jea_status = GetJEAStatus(cookie=ghpython_script_4, project_id=create_jea_project.project_id)  # -> output; inputs cookie: list, project_id: list
# ---------- get_jea_status: Python ----------
# -*- coding: utf-8 -*-
""" 
Python Script
Created on  Tuesday September 2020 08:46:17 
@author:  BT 

[desc]
Description of the plugin Here
Write here any thing... 
[/desc]

ARGUMENTS:
----------
<inp> 
    _input :[required] - [type = int] - [default = None] 
    Descripe your input here 
        * bullet point.
        * bullet point
</inp>
<inp>
    Other inputs go here ...
</inp>

RETURN:
----------
    <out>
        output_ : indicate your output description here. \n refers to a new line.
    </out>

"""
import requests, pickle

# API endpoint URL
ApiBase = 'https://api.ensims.com/'
JeaApi = ApiBase + "jea_web/api/"

#Load cookie
r = requests.get(JeaApi + 'info')
with open(cookie, 'rb') as f:
    r.cookies.update(pickle.load(f))

# Get the status of the project
r = requests.get(JeaApi + 'start/' + project_id, cookies=r.cookies)

# Show response
output = r.json()
# ---------- end get_jea_status ----------
panel_6 = Panel(jess_login)
cookie = Data(ensims_login.cookie)  # disabled
panel_7 = Panel(get_jea_status)
panel_8 = Panel("C:/Users/BT/Documents/GitHub/JESS-Grasshopper/job_example/Shoebox_v8.9.zip")
# TODO
# Comparison tests
# 1. parametric run with multiple jobs
# 2. big idf file 20min+
panel_9 = Panel("c:/windows/win.ini")
cookie_2 = Data(ensims_login.cookie)
entwine = Entwine(Branch00=panel_3, Branch01=panel_4, FlattenInputs=True)
check_cookie = CheckCookie(cookie=ensims_login.cookie)  # -> output, cookie; inputs cookie: list
# ---------- check_cookie: Python ----------
# -*- coding: utf-8 -*-
""" 
Python Script
Created on  Sunday September 2020 09:40:26 
@author:  amd 

[desc]
Description of the plugin Here
Write here any thing... 
[/desc]

ARGUMENTS:
----------
<inp> 
    cookie :[required] - [type = string] - [default = None] 
    Descripe your input here 
        * bullet point
</inp>

RETURN:
----------
    <out>
        output : indicate your output description here. \n refers to a new line.
    </out>

"""

import requests, pickle

# API endpoint URL
ApiBase = 'https://api.ensims.com/'
# ApiBase = 'https://localhost:8443/'
UserApi = ApiBase + 'users/api/'

#Load cookie
r = requests.get(UserApi + 'info')
with open(cookie, 'rb') as f:
    r.cookies.update(pickle.load(f))

#Check-in
r = requests.post(UserApi + 'checkin', cookies=r.cookies)

# Update the copy of the key if successful
if r.json()['ok']:
    cookies = r.cookies

# Show the response
output = r.json()
# ---------- end check_cookie ----------
upload_files = UploadFiles(cookie=cookie, folder="test/0", file=panel_9)  # -> output; inputs cookie: list, folder: list, file: list
# ---------- upload_files: Python ----------
# -*- coding: utf-8 -*-
""" 
Python Script
Created on  Sunday September 2020 10:05:19 
@author:  amd 

[desc]
Description of the plugin Here
Write here any thing... 
[/desc]

ARGUMENTS:
----------
<inp> 
    _input :[required] - [type = int] - [default = None] 
    Descripe your input here 
        * bullet point.
        * bullet point
</inp>
<inp>
    Other inputs go here ...
</inp>

RETURN:
----------
    <out>
        output_ : indicate your output description here. \n refers to a new line.
    </out>

"""
import requests, pickle

# API endpoint URL
ApiBase = 'https://api.ensims.com/'
# ApiBase = 'https://localhost:8443/'
UserApi = ApiBase + 'users/api/'

#Load cookie
r = requests.get(UserApi + 'info')
with open(cookie, 'rb') as f:
    r.cookies.update(pickle.load(f))

# upload a file to a particular folder
files = {'file': open(file, 'rb')}

# POST with files
r = requests.post(UserApi + 'files/' + folder, files=files, cookies=r.cookies)

# Show the returned status
output = r.json()
# ---------- end upload_files ----------
upload_files_2 = UploadFiles(cookie=cookie, folder="test/0", file=panel_8)  # -> output; inputs cookie: list, folder: list, file: list; same code as upload_files
delete_folder = DeleteFolder(cookie=cookie, folder="test")  # -> output; inputs cookie: list, folder: list
# ---------- delete_folder: Python ----------
# -*- coding: utf-8 -*-
""" 
Python Script
Created on  Sunday September 2020 10:05:19 
@author:  amd 

[desc]
Description of the plugin Here
Write here any thing... 
[/desc]

ARGUMENTS:
----------
<inp> 
    _input :[required] - [type = int] - [default = None] 
    Descripe your input here 
        * bullet point.
        * bullet point
</inp>
<inp>
    Other inputs go here ...
</inp>

RETURN:
----------
    <out>
        output_ : indicate your output description here. \n refers to a new line.
    </out>

"""
import requests, pickle

# API endpoint URL
ApiBase = 'https://api.ensims.com/'
# ApiBase = 'https://localhost:8443/'
UserApi = ApiBase + 'users/api/'

#Load cookie
r = requests.get(UserApi + 'info')
with open(cookie, 'rb') as f:
    r.cookies.update(pickle.load(f))

# POST with files
r = requests.delete(UserApi + 'files/' + folder, cookies=r.cookies)

# Show the returned status
output = r.json()
# ---------- end delete_folder ----------
post_job = PostJob(cookie=cookie_2, files=panel_3)  # -> output, job_id; inputs files: tree
# ---------- post_job: Python ----------
# -*- coding: utf-8 -*-
""" 
Python Script
Created on  Sunday September 2020 10:05:19 
@author:  amd 

[desc]
Description of the plugin Here
Write here any thing... 
[/desc]

ARGUMENTS:
----------
<inp> 
    cookie :[required] - [type = string] - [default = None] 
    Descripe your input here 
        * bullet point.
        * bullet point
</inp>
<inp>
    files :[required] - [type = string] - [default = None] 
    Descripe your input here 
        * bullet point.
        * bullet point
</inp>

RETURN:
----------
    <out>
        output_ : indicate your output description here. \n refers to a new line.
    </out>

"""
import requests, pickle

ApiBase = 'https://api.ensims.com/'
JessApi = ApiBase + "jess_web/api/"

#Load cookie
r = requests.get(JessApi + 'info')
with open(cookie, 'rb') as f:
    r.cookies.update(pickle.load(f))

# retrieve a file in a particular folder
r = requests.post(JessApi + 'job', files=files, cookies=r.cookies)

# Show the returned status
output = r.json()
job_id = r.json()['data']
# ---------- end post_job ----------
download_file = DownloadFile(cookie=cookie, file="test/0/win.ini")  # -> output; inputs cookie: list, file: list
# ---------- download_file: Python ----------
# -*- coding: utf-8 -*-
""" 
Python Script
Created on  Sunday September 2020 10:05:19 
@author:  amd 

[desc]
Description of the plugin Here
Write here any thing... 
[/desc]

ARGUMENTS:
----------
<inp> 
    _input :[required] - [type = int] - [default = None] 
    Descripe your input here 
        * bullet point.
        * bullet point
</inp>
<inp>
    Other inputs go here ...
</inp>

RETURN:
----------
    <out>
        output_ : indicate your output description here. \n refers to a new line.
    </out>

"""
import requests, pickle

# API endpoint URL
ApiBase = 'https://api.ensims.com/'
# ApiBase = 'https://localhost:8443/'
UserApi = ApiBase + 'users/api/'

#Load cookie
r = requests.get(UserApi + 'info')
with open(cookie, 'rb') as f:
    r.cookies.update(pickle.load(f))

# retrieve a file in a particular folder
r = requests.get(UserApi + 'files/' + file, cookies=r.cookies)

# Show the contents of the downloaded file
output = r.text
# ---------- end download_file ----------
view_folder = ViewFolder(cookie=cookie, folder="test/0")  # -> output; inputs cookie: list, folder: list
# ---------- view_folder: Python ----------
# -*- coding: utf-8 -*-
""" 
Python Script
Created on  Sunday September 2020 10:05:19 
@author:  amd 

[desc]
Description of the plugin Here
Write here any thing... 
[/desc]

ARGUMENTS:
----------
<inp> 
    _input :[required] - [type = int] - [default = None] 
    Descripe your input here 
        * bullet point.
        * bullet point
</inp>
<inp>
    Other inputs go here ...
</inp>

RETURN:
----------
    <out>
        output_ : indicate your output description here. \n refers to a new line.
    </out>

"""
import requests, pickle

# API endpoint URL
ApiBase = 'https://api.ensims.com/'
# ApiBase = 'https://localhost:8443/'
UserApi = ApiBase + 'users/api/'

#Load cookie
r = requests.get(UserApi + 'info')
with open(cookie, 'rb') as f:
    r.cookies.update(pickle.load(f))

# POST with files
r = requests.get(UserApi + 'files/' + folder, cookies=r.cookies)

# Show the returned status
try: 
    output = r.json()
except:
    output = "No directory called: " + folder
# ---------- end view_folder ----------
post_job_2 = PostJob(cookie=cookie_2, files=entwine)  # -> output, job_id; inputs files: tree
# ---------- post_job_2: Python ----------
# -*- coding: utf-8 -*-
""" 
Python Script
Created on  Sunday September 2020 10:05:19 
@author:  amd 

[desc]
Description of the plugin Here
Write here any thing... 
[/desc]

ARGUMENTS:
----------
<inp> 
    cookie :[required] - [type = string] - [default = None] 
    Descripe your input here 
        * bullet point.
        * bullet point
</inp>
<inp>
    files :[required] - [type = string] - [default = None] 
    Descripe your input here 
        * bullet point.
        * bullet point
</inp>

RETURN:
----------
    <out>
        output : asdsxzd
    </out>

"""
import requests, pickle

print(len(files))
for file in files:
    ApiBase = 'https://api.ensims.com/'
    JessApi = ApiBase + "jess_web/api/"

    #Load cookie
    r = requests.get(JessApi + 'info')
    with open(cookie, 'rb') as f:
        r.cookies.update(pickle.load(f))

    # retrieve a file in a particular folder
    r = requests.post(JessApi + 'job', files=file, cookies=r.cookies)

    # Show the returned status
    output = r.json()
    job_id = r.json()['data']
# ---------- end post_job_2 ----------
panel_10 = Panel(check_cookie.output)
panel_11 = Panel(upload_files)
panel_12 = Panel(upload_files_2)
panel_13 = Panel(view_folder)
panel_14 = Panel(download_file)
panel_15 = Panel(post_job.output)
panel_16 = Panel(delete_folder)
job_id = Data(post_job.job_id)
data_recorder = DataRecorder(job_id, DataLimit=-10, RecordData=True)
check_status = CheckStatus(cookie=cookie_2, job_id=data_recorder)  # -> output
# ---------- check_status: Python ----------
# -*- coding: utf-8 -*-
""" 
Python Script
Created on  Monday September 2020 12:08:26 
@author:  amd 

[desc]
Description of the plugin Here
Write here any thing... 
[/desc]

ARGUMENTS:
----------
<inp> 
    job_id :[required] - [type = string] - [default = None] 
    Descripe your input here 
        * bullet point.
        * bullet point
</inp>
<inp>
    cookie :[required] - [type = string] - [default = None] 
    Descripe your input here 
        * bullet point.
        * bullet point
</inp>

RETURN:
----------
    <out>
        output : indicate your output description here. \n refers to a new line.
    </out>

"""
import requests, pickle, sys, io, json

def get_job_status(job_id, cookie):
    #API endpoint URL
    ApiBase = 'https://api.ensims.com/'
    JessApi = ApiBase + "jess_web/api/"

    r = requests.get(JessApi + 'info')
    with open(cookie, 'rb') as f:
        r.cookies.update(pickle.load(f))
    #print('job/status/' + str(job_id))
    r = requests.get(JessApi + 'job/status/' + job_id, cookies=r.cookies)
    #output = r.json()['data']['status']
    return r.json()

output = get_job_status(job_id, cookie)
# ---------- end check_status ----------
retrieve_job_output = RetrieveJobOutput(cookie=cookie_2, job_id=data_recorder)  # -> output; inputs cookie: list
# ---------- retrieve_job_output: Python ----------
# -*- coding: utf-8 -*-
""" 
Python Script
Created on  Monday September 2020 12:08:26 
@author:  amd 

[desc]
Description of the plugin Here
Write here any thing... 
[/desc]

ARGUMENTS:
----------
<inp> 
    job_id :[required] - [type = int] - [default = None] 
    Descripe your input here 
        * bullet point.
        * bullet point
</inp>
<inp>
    cookie :[required] - [type = string] - [default = None] 
    Descripe your input here 
        * bullet point.
        * bullet point
</inp>

RETURN:
----------
    <out>
        output : indicate your output description here. \n refers to a new line.
    </out>

"""
import requests, pickle

#API endpoint URL
ApiBase = 'https://api.ensims.com/'
JessApi = ApiBase + "jess_web/api/"

#Load cookie
r = requests.get(JessApi + 'info')
with open(cookie, 'rb') as f:
    r.cookies.update(pickle.load(f))

# GET job status with job_id
r = requests.get(JessApi + 'job/dir/' + str(job_id), cookies=r.cookies)

# Show the returned status
output = r.json()
# ---------- end retrieve_job_output ----------
ghpython_script_5 = GhPythonScript(x=panel_12)  # -> out; disabled
# ---------- ghpython_script_5: Python ----------
__author__ = "BT"
__version__ = "2020.09.29"

out = x.replace('True','true').replace('False','false')
# ---------- end ghpython_script_5 ----------
ghpython_script_6 = GhPythonScript(x=panel_10)  # -> out; same code as ghpython_script_5
ghpython_script_7 = GhPythonScript(x=panel_11)  # -> out; disabled; same code as ghpython_script_5
# Where is downloaded file?
deserialize_json = DeserializeJson(JSON=ghpython_script_5, OutputsLocked=False)  # -> Ok, Status, FileHandle, Callback; disabled
deserialize_json_2 = DeserializeJson(JSON=ghpython_script_7, OutputsLocked=False)  # -> Ok, Status, FileHandle, Callback; disabled
deserialize_json_3 = DeserializeJson(JSON=ghpython_script_6, OutputsLocked=False)  # -> Ok, Status, Jwt, User, Role, Email
ghpython_script_8 = GhPythonScript(x=check_status)  # -> out; same code as ghpython_script_5
ghpython_script_9 = GhPythonScript(x=retrieve_job_output)  # -> out; same code as ghpython_script_5
deserialize_json_4 = DeserializeJson(JSON=ghpython_script_8, OutputsLocked=False)  # -> Ok, Status, Data
deserialize_json_5 = DeserializeJson(JSON=ghpython_script_9, OutputsLocked=False)  # -> Ok, Status, Data
deserialize_json_6 = DeserializeJson(JSON=deserialize_json_5.Data, OutputsLocked=False)  # -> FileName, Open, Nocheck, FileSize, Children, Name
panel_17 = Panel(deserialize_json_4.Data)
ghpython_script_10 = GhPythonScript(x=panel_13)  # -> out; same code as ghpython_script_5
deserialize_json_7 = DeserializeJson(JSON=deserialize_json_6.Children, OutputsLocked=False)  # -> FileName, Open, Nocheck, FileSize, Children, Name
item = Slider(0, range=0..20)
deserialize_json_8 = DeserializeJson(JSON=ghpython_script_10, OutputsLocked=False)  # -> FileName, Open, Nocheck, FileSize, Children, Name
deserialize_json_9 = DeserializeJson(JSON=deserialize_json_8.Children, OutputsLocked=False)  # -> FileName, Open, Nocheck, FileSize, Children, Name
list_item = ListItem(List=deserialize_json_7.FileName, Index=item, Wrap=True)
panel_18 = Panel(deserialize_json_8.FileName)
false_start_toggle_3 = FalseStartToggle(False)
filenames = Panel(deserialize_json_7.FileName)
false_start_toggle_4 = FalseStartToggle(False)
panel_19 = Panel(list_item)
panel_20 = Panel(deserialize_json_9.FileName)
deserialize_json_10 = DeserializeJson(JSON=deserialize_json_9.Children, OutputsLocked=False)  # -> FileName, Open, Nocheck, FileSize, Children, Name
text_from_file = TextFromFile(cookie=cookie_2, job_id=data_recorder, filename=panel_19, run=false_start_toggle_3)  # -> output
# ---------- text_from_file: Python ----------
# -*- coding: utf-8 -*-
""" 
Python Script
Created on  Monday September 2020 12:08:26 
@author:  amd 

[desc]
Description of the plugin Here
Write here any thing... 
[/desc]

ARGUMENTS:
----------
<inp> 
    job_id :[required] - [type = string] - [default = None] 
    Descripe your input here 
        * bullet point.
        * bullet point
</inp>
<inp>
    cookie :[required] - [type = string] - [default = None] 
    Descripe your input here 
        * bullet point.
        * bullet point
</inp>
<inp>
    filename :[required] - [type = string] - [default = None] 
    Descripe your input here 
        * bullet point.
        * bullet point
</inp>

RETURN:
----------
    <out>
        output : indicate your output description here. \n refers to a new line.
    </out>

"""
import requests, pickle

if run == True:
    #API endpoint URL
    ApiBase = 'https://api.ensims.com/'
    JessApi = ApiBase + "jess_web/api/"

    #Load cookie
    r = requests.get(JessApi + 'info')
    with open(cookie, 'rb') as f:
        r.cookies.update(pickle.load(f))

        # GET specific text with job_id and filename
        r = requests.get(JessApi + 'job/file/' + str(job_id) + '/' + filename, cookies=r.cookies)
        
        # Show the returned status
        output = r.text
else:
    output = False
# ---------- end text_from_file ----------
download_job = DownloadJob(
    job_id=data_recorder,
    cookie=cookie_2,
    folder="C:/Users/amd/Documents/GitHub/JESS-Grasshopper/",
    run=false_start_toggle_4)  # -> output
# ---------- download_job: Python ----------
# -*- coding: utf-8 -*-
""" 
Python Script
Created on  Monday September 2020 12:08:26 
@author:  amd 

[desc]
Description of the plugin Here
Write here any thing... 
[/desc]

ARGUMENTS:
----------
<inp> 
    job_id :[required] - [type = string] - [default = None] 
    Descripe your input here 
        * bullet point.
        * bullet point
</inp>
<inp>
    cookie :[required] - [type = string] - [default = None] 
    Descripe your input here 
        * bullet point.
        * bullet point
</inp>
<inp>
    folder :[required] - [type = string] - [default = None] 
    Descripe your input here 
        * bullet point.
        * bullet point
</inp>
<inp>
    run :[required] - [type = bool] - [default = False] 
    Descripe your input here 
        * bullet point.
        * bullet point
</inp>

RETURN:
----------
    <out>
        output : indicate your output description here. \n refers to a new line.
    </out>

"""
import requests, pickle, os

#API endpoint URL
ApiBase = 'https://api.ensims.com/'
JessApi = ApiBase + "jess_web/api/"

if run == True:
    #Load cookie
    r = requests.get(JessApi + 'info')
    with open(cookie, 'rb') as f:
        r.cookies.update(pickle.load(f))

    # Download all job output in as a zip file
    r = requests.get(JessApi + 'job/file/' + str(job_id), cookies=r.cookies)

    # Create the download/ folder to save the zip file
    if not os.path.exists(folder):
        try:
            os.mkdir(folder)
        except OSError:
            output = "Creation of the directory %s failed" % folder
        else:
            print ("Successfully created the directory %s " % folder)
    # Save the contents of the downloaded file
    bytes = open(folder + str(job_id) + '.zip', 'wb').write(r.content)
    # Show the returned status
    output = str(bytes) + ' bytes written to ' + folder + job_id + '.zip'
else:
    output = False
# ---------- end download_job ----------
panel_21 = Panel(deserialize_json_10.Name)
panel_22 = Panel(text_from_file)
panel_23 = Panel(download_job)
